# Grasshopper definition LoadsFromReferenceObjects.gh (Grasshopper 1.0.7)
# plug-ins: GSA

# Prop2d
number_slider = Slider(15, range=0..100)
# Member1d
number_slider_2 = Slider(15, range=0..100)
# Element1d
number_slider_3 = Slider(15, range=0..100)
# Section
panel = Panel("15")
profile = CreateProfile(
    Depth_cm=panel,
    Width_cm=panel,
    NumberOfInputs=2,
    catalogueIndex=-1,
    inclSS=False,
    lengthUnit="Centimeter",
    mode="Other",
    Profile_type="Rectangle",
    Measure="cm",
    typeIndex=-1)
pt = ConstructPoint(XCoordinate=0, YCoordinate=0, ZCoordinate=0)
pt_2 = ConstructPoint(XCoordinate=0, YCoordinate=number_slider_2, ZCoordinate=0)
# Member2d
pt_3 = ConstructPoint(XCoordinate=0, YCoordinate=0, ZCoordinate=0)
pt_4 = ConstructPoint(XCoordinate=0, YCoordinate=number_slider, ZCoordinate=0)
pt_5 = ConstructPoint(XCoordinate=number_slider, YCoordinate=number_slider, ZCoordinate=0)
pt_6 = ConstructPoint(XCoordinate=number_slider, YCoordinate=0, ZCoordinate=0)
pt_7 = ConstructPoint(XCoordinate=0, YCoordinate=0, ZCoordinate=0)
pt_8 = ConstructPoint(XCoordinate=0, YCoordinate=number_slider_3, ZCoordinate=0)
prop2d = Create2DProperty(Thickness_cm="15", Type="Shell", Unit="cm")
# Element2d
mplane = MeshPlane(Boundary={Plane=PlaneXY(0, 0, 0), Size=Domain2(u=-10..10, v=-10..10)}, WidthCount=10, HeightCount=10)  # -> Mesh, Area
section = CreateSection(Profile=profile)
ln = Line(StartPoint=pt, EndPoint=pt_2)
prop2d_2 = Create2DProperty(Thickness_cm="15", Type="Shell", Unit="cm")
ln_2 = Line(StartPoint=pt_7, EndPoint=pt_8)
srf4pt = _4PointSurface(CornerA=pt_3, CornerB=pt_4, CornerC=pt_5, CornerD=pt_6)
elem1d = Create1DElement(Line=ln_2)
sectionedit = EditSection(Section=section, SectionNumber="7")  # -> Section, SectionNumber, SectionProfile, Material, SectionModifier, SectionPool, SectionName, SectionColour
mem1d = Create1DMember(
    Curve=ln,
    Section=sectionedit.Section,
    MeshSizeInModelUnits=Slider(0.5, range=0..1),
    x1=False,
    x2=False,
    xx1=False,
    xx2=False,
    y1=False,
    y2=False,
    yy1=False,
    yy2=False,
    z1=False,
    z2=False,
    zz1=False,
    zz2=False)
elem2d = Create2DElement(Mesh=mplane.Mesh, Prop2D=prop2d)
e2d = Element2D(elem2d)
e2d_2 = Element2D(e2d)
m1d = Member1D(mem1d)
m1d_2 = Member1D(m1d)
# Gravity
pb = Section(sectionedit.Section)
pb_2 = Section(pb)
prop2dedit = Edit2DProperty(Prop2D=prop2d_2, Prop2dNumber="19", LengthUnit="Centimeter")  # -> Prop2D, Prop2dNumber, Material, Thickness_cm, Axis, Prop2dName, Prop2dColour, Type
pa = Prop2D(prop2dedit.Prop2D)
# GridSurface
pa_2 = Prop2D(pa)
mem2d = Create2DMember(Brep=srf4pt, Prop2D=prop2dedit.Prop2D)
m2d = Member2D(mem2d)
m2d_2 = Member2D(m2d)
series = Series(Start="1", Step=1, Count="6")
series_2 = Series(Start="1", Step=1, Count="6")
beamload = CreateBeamLoad(
    LoadCase=1,
    ElementList=elem1d,
    Axis=0,
    Direction="z",
    Projected=False,
    ValueStart_kN_m=Slider(15, range=0..100),
    ValueEnd_kN_m=Slider(27, range=0..100),
    Type="Linear",
    Unit="kN/m")
faceload = CreateFaceLoad(
    LoadCase=1,
    ElementList=mem2d,
    Axis=-1,
    Direction="z",
    Projected=False,
    Value_kN_m²=Slider(5, range=0..10),
    Type="Uniform",
    Unit="kN/m²")
elem1dedit = Edit1DElement(Element1D=elem1d, Number="42")  # -> Element1D, Number, Line, Section, Group, Type, Offset, StartRelease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
e1d = Element1D(elem1dedit.Element1D)
e1d_2 = Element1D(e1d)
beamload_2 = CreateBeamLoad(
    LoadCase=1,
    ElementList=sectionedit.Section,
    Axis=0,
    Direction="z",
    Projected=False,
    Value_kN_m=Slider(15, range=0..100),
    Type="Uniform",
    Unit="kN/m")
faceload_2 = CreateFaceLoad(
    LoadCase=1,
    ElementList=prop2dedit.Prop2D,
    Axis=-1,
    Direction="z",
    Projected=False,
    Value_kN_m²=Slider(5, range=0..10),
    Type="Uniform",
    Unit="kN/m²")
beamload_3 = CreateBeamLoad(
    LoadCase=1,
    ElementList=mem1d,
    Axis=0,
    Direction="z",
    Projected=False,
    Value_kN_m=Slider(15, range=0..100),
    Type="Uniform",
    Unit="kN/m")
entwine = Entwine(Branch00=pb_2, Branch01=pa_2, Branch02=e1d_2, Branch03=e2d_2, Branch04=m1d_2, Branch05=m2d_2, FlattenInputs=True)
faceload_3 = CreateFaceLoad(
    LoadCase=1,
    ElementList=elem2d,
    Axis=-1,
    Direction="z",
    Projected=False,
    Value1_kN_m²=Slider(4, range=0..10),
    Value2_kN_m²=Slider(4, range=0..10),
    Value3_kN_m²=Slider(4, range=0..10),
    Value4_kN_m²=Slider(4, range=0..10),
    Type="Variable",
    Unit="kN/m²")
entwine_2 = Entwine(Branch00=pb, Branch01=pa, Branch02=e1d, Branch03=e2d, Branch04=m1d, Branch05=m2d, FlattenInputs=True)
gridsurface = CreateGridSurface(GridSurfaceID=graft(series), ElementList=entwine, SpanDirection=0, Type="1D, One-way span")  # -> flatten(GridSurface)
gravityload = CreateGravityLoad(LoadCase=graft(series_2), ElementList=entwine_2, GravityFactor=Vector(0, 0, -1))  # -> flatten(GravityLoad)
model = CreateModel(GSAGeometryIn_m=elem2d, Load=faceload_3, ReMesh=True, Unit="m")
model_2 = CreateModel(GSAGeometryIn_m=elem1dedit.Element1D, Load=beamload, ReMesh=True, Unit="m")
model_3 = CreateModel(GSAGeometryIn_m=mem1d, Load=beamload_2, ReMesh=True, Unit="m")
model_4 = CreateModel(GSAGeometryIn_m=mem1d, Load=beamload_3, ReMesh=True, Unit="m")
model_5 = CreateModel(GSAGeometryIn_m=mem2d, Load=faceload, ReMesh=True, Unit="m")
model_6 = CreateModel(GSAGeometryIn_m=mem2d, Load=faceload_2, ReMesh=True, Unit="m")
areaload = CreateGridAreaLoad(
    LoadCase=1,
    GridPlaneSurface=gridsurface,
    Direction="z",
    Axis=0,
    Projected=False,
    Value_kN_m²=Slider(5, range=0..10),
    Unit="kN/m²")
model_7 = CreateModel(Properties=[pb_2, pa_2], GSAGeometryIn_m=[e1d_2, e2d_2, m2d_2, m1d_2], Load=areaload, ReMesh=True, Unit="m")
model_8 = CreateModel(Properties=[pb, pa], GSAGeometryIn_m=[e1d, e2d, m2d, m1d], Load=gravityload, ReMesh=True, Unit="m")
getgeo = GetModelGeometry(GSAModel=model, NodeFilterList="All", ElementFilterList="All", MemberFilterList="All", Mode=1, Unit="m")  # -> Nodes_m, _1DElements_m, _2DElements_m, _3DElements_m, _1DMembers_m, _2DMembers_m, _3DMembers_m
getloads = GetModelLoads(GSAModel=model, Unit="m")  # -> GravityLoads, NodeLoads, BeamLoads, FaceLoads, GridPointLoads_m, GridLineLoads_m, GridAreaLoads_m, GridPlaneSurfaces_m
getgeo_2 = GetModelGeometry(GSAModel=model_2, NodeFilterList="All", ElementFilterList="All", MemberFilterList="All", Mode=1, Unit="m")  # -> Nodes_m, _1DElements_m, _2DElements_m, _3DElements_m, _1DMembers_m, _2DMembers_m, _3DMembers_m
getloads_2 = GetModelLoads(GSAModel=model_2, Unit="m")  # -> GravityLoads, NodeLoads, BeamLoads, FaceLoads, GridPointLoads_m, GridLineLoads_m, GridAreaLoads_m, GridPlaneSurfaces_m
getgeo_3 = GetModelGeometry(GSAModel=model_5, NodeFilterList="All", ElementFilterList="All", MemberFilterList="All", Mode=1, Unit="m")  # -> Nodes_m, _1DElements_m, _2DElements_m, _3DElements_m, _1DMembers_m, _2DMembers_m, _3DMembers_m
getloads_3 = GetModelLoads(GSAModel=model_5, Unit="m")  # -> GravityLoads, NodeLoads, BeamLoads, FaceLoads, GridPointLoads_m, GridLineLoads_m, GridAreaLoads_m, GridPlaneSurfaces_m
getloads_4 = GetModelLoads(GSAModel=model_4, Unit="m")  # -> GravityLoads, NodeLoads, BeamLoads, FaceLoads, GridPointLoads_m, GridLineLoads_m, GridAreaLoads_m, GridPlaneSurfaces_m
getgeo_4 = GetModelGeometry(GSAModel=model_4, NodeFilterList="All", ElementFilterList="All", MemberFilterList="All", Mode=1, Unit="m")  # -> Nodes_m, _1DElements_m, _2DElements_m, _3DElements_m, _1DMembers_m, _2DMembers_m, _3DMembers_m
getloads_5 = GetModelLoads(GSAModel=model_6, Unit="m")  # -> GravityLoads, NodeLoads, BeamLoads, FaceLoads, GridPointLoads_m, GridLineLoads_m, GridAreaLoads_m, GridPlaneSurfaces_m
getloads_6 = GetModelLoads(GSAModel=model_3, Unit="m")  # -> GravityLoads, NodeLoads, BeamLoads, FaceLoads, GridPointLoads_m, GridLineLoads_m, GridAreaLoads_m, GridPlaneSurfaces_m
elem2dedit = Edit2DElement(Element2D=getgeo._2DElements_m)  # -> Element2D, Number, AnalysisMesh, _2DProperty, Group, ElementType, Offset, Name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
getloads_7 = GetModelLoads(GSAModel=model_7, Unit="m")  # -> GravityLoads, NodeLoads, BeamLoads, FaceLoads, GridPointLoads_m, GridLineLoads_m, GridAreaLoads_m, GridPlaneSurfaces_m
loadprop = LoadProperties(Load=getloads.FaceLoads, Force_Unit="kN", Length_Unit="m")  # -> LC, Na, Def, Ax, Di, Pj, V1, V2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
getloads_8 = GetModelLoads(GSAModel=model_8, Unit="m")  # -> GravityLoads, NodeLoads, BeamLoads, FaceLoads, GridPointLoads_m, GridLineLoads_m, GridAreaLoads_m, GridPlaneSurfaces_m
getgeo_5 = GetModelGeometry(GSAModel=model_7, NodeFilterList="All", ElementFilterList="All", MemberFilterList="All", Mode=1, Unit="m")  # -> Nodes_m, _1DElements_m, _2DElements_m, _3DElements_m, _1DMembers_m, _2DMembers_m, _3DMembers_m
getgeo_6 = GetModelGeometry(GSAModel=model_8, NodeFilterList="All", ElementFilterList="All", MemberFilterList="All", Mode=1, Unit="m")  # -> Nodes_m, _1DElements_m, _2DElements_m, _3DElements_m, _1DMembers_m, _2DMembers_m, _3DMembers_m
loadprop_2 = LoadProperties(Load=getloads_2.BeamLoads, Force_Unit="kN", Length_Unit="m")  # -> LC, Na, Def, Ax, Di, Pj, V1, V2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
int = Integer(getgeo_2._1DElements_m)
gridplanesurfaceprop = GridPlaneSurfaceProperties(GridPlaneSurface=getloads_7.GridPlaneSurfaces_m, LengthUnit="Meter")  # -> GridPlane, GridPlaneID, GridPlaneName, IsStorey, Axis, AxisID, Elevation_m, GridPlaneToleranceAbove_m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
loadprop_3 = LoadProperties(Load=getloads_4.BeamLoads, Force_Unit="kN", Length_Unit="m")  # -> LC, Na, Def, Ax, Di, Pj, V1, V2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
loadprop_4 = LoadProperties(Load=getloads_3.FaceLoads, Force_Unit="kN", Length_Unit="m")  # -> LC, Na, Def, Ax, Di, Pj, V1, V2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
loadprop_5 = LoadProperties(Load=getloads_5.FaceLoads, Force_Unit="kN", Length_Unit="m")  # -> LC, Na, Def, Ax, Di, Pj, V1, V2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
elem2dedit_2 = Edit2DElement(Element2D=getgeo_3._2DElements_m)  # -> Element2D, Number, AnalysisMesh, _2DProperty, Group, ElementType, Offset, Name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
loadprop_6 = LoadProperties(Load=getloads_6.BeamLoads, Force_Unit="kN", Length_Unit="m")  # -> LC, Na, Def, Ax, Di, Pj, V1, V2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
loadprop_7 = LoadProperties(Load=getloads_8.GravityLoads, Force_Unit="kN", Length_Unit="m")  # -> LC, Na, Def, Ax, Di, Pj, V1, V2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
int_2 = Integer(loadprop_2.Def)
int_3 = Integer(getgeo_4._1DElements_m)
int_4 = Integer(elem2dedit.Number)
panel_2 = Panel(loadprop.Def)
panel_3 = Panel(int_2)
split = TextSplit(Text=loadprop.Def, Separators=" ")
panel_4 = Panel(loadprop_4.Def)
panel_5 = Panel(loadprop_3.Def)
equals = Equality(FirstNumber=int, SecondNumber=int_2)  # -> Equality, Inequality
item = ListItem(List=gridplanesurfaceprop.Elements, Index=0, Wrap=True)  # -> Item, Item1, Item2, Item3, Item4, Item5
item_2 = ListItem(List=loadprop_7.Def, Index=0, Wrap=True)  # -> Item, Item1, Item2, Item3, Item4, Item5
int_5 = Integer(split)
split_2 = TextSplit(Text=loadprop_3.Def, Separators=" ")
split_3 = TextSplit(Text=loadprop_4.Def, Separators=" ")
int_6 = Integer(elem2dedit_2.Number)

# ---- group: FaceLoadFromProp2dTest
txt = Text(loadprop_5.Def)

# ---- group: BeamLoadFromSectionTest
txt_2 = Text(loadprop_6.Def)

# ----
item_3 = ListItem(List=getgeo_5._2DElements_m, Index=0, Wrap=True)  # -> Item, Item1
item_4 = ListItem(List=getgeo_6._2DElements_m, Index=0, Wrap=True)  # -> Item, Item1

# ---- group: BeamLoadFromElementTest
bool = Boolean(equals.Equality)

# ----
int_7 = Integer(split_2)
int_8 = Integer(split_3)
keysearch = KeyValueSearch(Keys=int_5, Values=int_5, Search=int_4)
int_9 = Integer(getgeo_6._1DElements_m)
panel_6 = Panel(txt)
panel_7 = Panel(txt_2)
panel_8 = Panel(bool)
int_10 = Integer(getgeo_5._1DElements_m)
keysearch_2 = KeyValueSearch(Keys=int_7, Values=int_7, Search=int_3)
equals_2 = Equality(FirstNumber=int_4, SecondNumber=keysearch)  # -> Equality, Inequality
keysearch_3 = KeyValueSearch(Keys=int_8, Values=int_8, Search=int_6)
cull_i = CullIndex(List=int_9, Indices="0", Wrap=True)
cull_i_2 = CullIndex(List=int_10, Indices="0", Wrap=True)
equals_3 = Equality(FirstNumber=int_3, SecondNumber=keysearch_2)  # -> Equality, Inequality
ma = MassAddition(Input=equals_2.Inequality)  # -> Result, PartialResults
elem2dedit_3 = Edit2DElement(Element2D=item_3.Item1)  # -> Element2D, Number, AnalysisMesh, _2DProperty, Group, ElementType, Offset, Name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
elem2dedit_4 = Edit2DElement(Element2D=item_4.Item1)  # -> Element2D, Number, AnalysisMesh, _2DProperty, Group, ElementType, Offset, Name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
equals_4 = Equality(FirstNumber=int_6, SecondNumber=keysearch_3)  # -> Equality, Inequality
elem2dedit_5 = Edit2DElement(Element2D=item_3.Item)  # -> Element2D, Number, AnalysisMesh, _2DProperty, Group, ElementType, Offset, Name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
elem2dedit_6 = Edit2DElement(Element2D=item_4.Item)  # -> Element2D, Number, AnalysisMesh, _2DProperty, Group, ElementType, Offset, Name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
ma_2 = MassAddition(Input=equals_3.Inequality)  # -> Result, PartialResults

# ---- group: FaceLoadFromElementTest
int_11 = Integer(ma.Result)

# ----
ma_3 = MassAddition(Input=equals_4.Inequality)  # -> Result, PartialResults
split_4 = TextSplit(Text=item.Item5, Separators=" ")
int_12 = Integer(elem2dedit_3.Number)
split_5 = TextSplit(Text=item_2.Item5, Separators=" ")
split_6 = TextSplit(Text=item.Item3, Separators=" ")
int_13 = Integer(elem2dedit_4.Number)
int_14 = Integer(elem2dedit_5.Number)
split_7 = TextSplit(Text=item.Item4, Separators=" ")
split_8 = TextSplit(Text=item_2.Item3, Separators=" ")
int_15 = Integer(elem2dedit_6.Number)
split_9 = TextSplit(Text=item_2.Item4, Separators=" ")
zero_if_all_ids_found = Panel(int_11)

# ---- group: BeamLoadFromMemberTest
int_16 = Integer(ma_2.Result)

# ---- group: FaceLoadFromMemberTest
int_17 = Integer(ma_3.Result)

# ----
int_18 = Integer(split_4)
int_19 = Integer(split_5)
int_20 = Integer(split_6)
int_21 = Integer(split_7)
int_22 = Integer(split_8)
int_23 = Integer(split_9)
zero_if_all_ids_found_2 = Panel(int_16)
zero_if_all_ids_found_3 = Panel(int_17)
keysearch_4 = KeyValueSearch(Keys=int_18, Values=int_18, Search=int_12)
keysearch_5 = KeyValueSearch(Keys=int_21, Values=int_21, Search=cull_i_2)
keysearch_6 = KeyValueSearch(Keys=int_19, Values=int_19, Search=int_13)
keysearch_7 = KeyValueSearch(Keys=int_20, Values=int_20, Search=int_14)
keysearch_8 = KeyValueSearch(Keys=int_23, Values=int_23, Search=cull_i)
keysearch_9 = KeyValueSearch(Keys=int_22, Values=int_22, Search=int_15)
equals_5 = Equality(FirstNumber=int_12, SecondNumber=keysearch_4)  # -> Equality, Inequality
equals_6 = Equality(FirstNumber=cull_i_2, SecondNumber=keysearch_5)  # -> Equality, Inequality
equals_7 = Equality(FirstNumber=int_13, SecondNumber=keysearch_6)  # -> Equality, Inequality
equals_8 = Equality(FirstNumber=int_14, SecondNumber=keysearch_7)  # -> Equality, Inequality
equals_9 = Equality(FirstNumber=cull_i, SecondNumber=keysearch_8)  # -> Equality, Inequality
equals_10 = Equality(FirstNumber=int_15, SecondNumber=keysearch_9)  # -> Equality, Inequality
ma_4 = MassAddition(Input=equals_5.Inequality)  # -> Result, PartialResults
ma_5 = MassAddition(Input=equals_6.Inequality)  # -> Result, PartialResults
ma_6 = MassAddition(Input=equals_7.Inequality)  # -> Result, PartialResults
ma_7 = MassAddition(Input=equals_8.Inequality)  # -> Result, PartialResults
ma_8 = MassAddition(Input=equals_9.Inequality)  # -> Result, PartialResults
ma_9 = MassAddition(Input=equals_10.Inequality)  # -> Result, PartialResults

# ---- group: GridPlnSrfFromMem2d
int_24 = Integer(ma_4.Result)

# ---- group: GravityLoadFromMember2dTest
int_25 = Integer(ma_6.Result)

# ---- group: GridPlnSrfFromElem2d
int_26 = Integer(ma_7.Result)

# ---- group: GridPlnSrfFromMem1d
int_27 = Integer(ma_5.Result)

# ---- group: GridPlnSrfFromElem1d
int_28 = Integer(item.Item2)

# ---- group: GravityLoadFromElem2dTest
int_29 = Integer(ma_9.Result)

# ---- group: GravityLoadFromMember1dTest
int_30 = Integer(ma_8.Result)

# ---- group: GridPlnSrfFromProp2d
txt_3 = Text(item.Item1)

# ---- group: GravityLoadFromElem1dTest
int_31 = Integer(item_2.Item2)

# ---- group: GridPlnSrfFromSection
txt_4 = Text(item.Item)

# ---- group: GravityLoadFromProp2dTest
txt_5 = Text(item_2.Item1)

# ---- group: GravityLoadFromSectionTest
txt_6 = Text(item_2.Item)

# ----
zero_if_all_ids_found_4 = Panel(int_24)
zero_if_all_ids_found_5 = Panel(int_25)
zero_if_all_ids_found_6 = Panel(int_26)
zero_if_all_ids_found_7 = Panel(int_27)
zero_if_all_ids_found_8 = Panel(int_29)
zero_if_all_ids_found_9 = Panel(int_30)
panel_9 = Panel(int_28)
panel_10 = Panel(txt_3)
panel_11 = Panel(txt_4)
panel_12 = Panel(int_31)
panel_13 = Panel(txt_5)
panel_14 = Panel(txt_6)
