# Grasshopper definition CreateBool6Test.gh (Grasshopper 1.0.7)
# Copyright: Arup
# plug-ins: GSA

toggle = BooleanToggle(False)
toggle_2 = BooleanToggle(True)
panel = Panel("""Free
Pin
Fix
ffffff
rfffff
rrffff
rrrfff
rrrrff
rrrrrf
rrrrrr""")
pt = ConstructPoint(XCoordinate=0, YCoordinate=0, ZCoordinate=0)
support = CreateSupport(Point=pt, Plane=PlaneXY(0, 0, 0), Restraints=panel, x=True, xx=True, y=True, yy=True, z=True, zz=True)
b6 = CreateBool6(
    X=Toggle(True),
    Y=Toggle(False),
    Z=Toggle(True),
    XX=Toggle(False),
    YY=Toggle(True),
    ZZ=Toggle(False),
    x=True,
    xx=False,
    y=False,
    yy=True,
    z=True,
    zz=False)
nodeedit = EditNode(Node=support, Mode=1)  # -> Node, NodeNumber, NodePosition, NodeLocalAxis, NodeRestraints, DamperProperty, MassProperty, SpringProperty, NodeName, NodeColour
bool6edit = EditBool6(Bool6=nodeedit.NodeRestraints)  # -> Bool6, X, Y, Z, XX, YY, ZZ
bool6edit_2 = EditBool6(Bool6=b6)  # -> Bool6, X, Y, Z, XX, YY, ZZ
panel_2 = Panel("""GSA Bool6 (Free)
GSA Bool6 (Pin)
GSA Bool6 (Fixed)
GSA Bool6 (Free)
GSA Bool6 (X✓ Y☐ Z☐ XX☐ YY☐ ZZ☐)
GSA Bool6 (X✓ Y✓ Z☐ XX☐ YY☐ ZZ☐)
GSA Bool6 (Pin)
GSA Bool6 (X✓ Y✓ Z✓ XX✓ YY☐ ZZ☐)
GSA Bool6 (X✓ Y✓ Z✓ XX✓ YY✓ ZZ☐)
GSA Bool6 (Fixed)""")
panel_3 = Panel(bool6edit.Bool6)

# ---- group: X
bool = Boolean(bool6edit_2.X)

# ---- group: Y
bool_2 = Boolean(bool6edit_2.Y)

# ---- group: Z
bool_3 = Boolean(bool6edit_2.Z)

# ---- group: XX
bool_4 = Boolean(bool6edit_2.XX)

# ---- group: YY
bool_5 = Boolean(bool6edit_2.YY)

# ---- group: ZZ
bool_6 = Boolean(bool6edit_2.ZZ)

# ----
panel_4 = Panel(bool)
panel_5 = Panel(bool_2)
panel_6 = Panel(bool_3)
panel_7 = Panel(bool_4)
panel_8 = Panel(bool_5)
panel_9 = Panel(bool_6)
expression = Expression(x=panel_3, y=panel_2, Expression="if(x=y, True, False)")
cset = CreateSet(List=expression)  # -> Set, Map

# ---- group: Cast
bool_7 = Boolean(cset.Set)

# ----
panel_10 = Panel(bool_7)
