# Grasshopper definition SectionModifierTests.gh (Grasshopper 1.0.7)
# Copyright: Arup
# plug-ins: GSA

profile = CreateProfile(
    Depth_cm="60",
    Width_cm="60",
    catalogueIndex=-1,
    inclSS=False,
    lengthUnit="Centimeter",
    mode="Other",
    Profile_type="Rectangle",
    Measure="cm",
    typeIndex=-1)
sectprop = SectionProperties(Section=profile, LengthUnit="Centimeter")  # -> Area_cm², MomentOfInertiaYY_cm⁴, MomentOfInertiaZZ_cm⁴, MomentOfInertiaYZ_cm⁴, MomentOfInertiaUU_cm⁴, MomentOfInertiaVV_cm⁴, Angle_, ShearAreaFactorYY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
toggle = BooleanToggle(True)
profile_2 = CreateProfile(
    Depth_cm="40",
    Width_cm="40",
    catalogueIndex=-1,
    inclSS=False,
    lengthUnit="Centimeter",
    mode="Other",
    Profile_type="Rectangle",
    Measure="cm",
    typeIndex=-1)
sectionmodifier = CreateSectionModifier(
    AreaModifier_cm²=sectprop.Area_cm²,
    I11Modifier_cm⁴=sectprop.MomentOfInertiaYY_cm⁴,
    I22Modifier_cm⁴=sectprop.MomentOfInertiaZZ_cm⁴,
    JModifier_cm⁴=sectprop.TorsionConstantJ_cm⁴,
    K11Modifier_=sectprop.ShearAreaFactorYY,
    K22Modifier_=sectprop.ShearAreaFactorZZ,
    VolumeModifier_m³_m=sectprop.VolumeUnitLength_cm³_cm,
    AdditionalMass_kg_m=Slider(500, range=0..1000),
    PrincipalBendingAxis=Toggle(False),
    ReferencePointCentroid=Toggle(False),
    Modify_type="Modify to",
    Length_unit="Centimeter",
    Density_unit="kg/m",
    Stress_calc="Use modified",
    toMode=True)
sectionmodifier_2 = CreateSectionModifier(
    AreaModifier=Slider(0.5, range=0..1),
    I11Modifier="105 %",
    I22Modifier=Slider(0.7, range=0..1),
    JModifier=Slider(0.3, range=0..1),
    K11Modifier=Slider(0.35, range=0..1),
    K22Modifier=Slider(0.45, range=0..1),
    VolumeModifier=Slider(0.9, range=0..1),
    AdditionalMass_kg_m=Slider(1250, range=0..10000),
    PrincipalBendingAxis=toggle,
    ReferencePointCentroid=toggle,
    Modify_type="Modify by",
    Density_unit="kg/m",
    Stress_calc="Use unmodified",
    toMode=False)
pt = ConstructPoint(XCoordinate=0, YCoordinate=0, ZCoordinate=0)
sectionedit = EditSection(SectionProfile=profile_2, SectionModifier=sectionmodifier)  # -> Section, SectionNumber, SectionProfile, Material, BasicOffset, AddOffsetY_cm, AddOffsetZ_cm, SectionModifier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
editpb = EditSection(SectionProfile=profile_2, SectionModifier=sectionmodifier_2)  # -> Section, SectionNumber, SectionProfile, Material, BasicOffset, AddOffsetY_cm, AddOffsetZ_cm, SectionModifier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
line = LineSDL(Start=pt, Direction=Vector(0, 0, 1), Length=1)
elem1d = Create1DElement(Line=line, Section=sectionedit.Section, Preview3dSection=False)
sectprop_2 = SectionProperties(Section=sectionedit.Section, LengthUnit="Centimeter")  # -> Area_cm², MomentOfInertiaYY_cm⁴, MomentOfInertiaZZ_cm⁴, MomentOfInertiaYZ_cm⁴, MomentOfInertiaUU_cm⁴, MomentOfInertiaVV_cm⁴, Angle_, ShearAreaFactorYY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
panel = Panel([sectprop_2.Area_cm², sectprop_2.MomentOfInertiaYY_cm⁴, sectprop_2.MomentOfInertiaZZ_cm⁴, sectprop_2.MomentOfInertiaYZ_cm⁴, sectprop_2.MomentOfInertiaUU_cm⁴, sectprop_2.MomentOfInertiaVV_cm⁴, sectprop_2.Angle_, sectprop_2.ShearAreaFactorYY, sectprop_2.ShearAreaFactorZZ, sectprop_2.ShearAreaFactorUU, sectprop_2.ShearAreaFactorVV, sectprop_2.TorsionConstantJ_cm⁴, sectprop_2.TorsionConstantC_cm³, sectprop_2.SectionModulusInY_cm³, sectprop_2.SectionModulusInZ_cm³, sectprop_2.PlasticModulusInY_cm³, sectprop_2.PlasticModulusInZ_cm³, sectprop_2.ElasticCentroidInY_cm, sectprop_2.ElasticCentroidInZ_cm, sectprop_2.RadiusOfGyrationInY_cm, sectprop_2.RadiusOfGyrationInZ_cm, sectprop_2.SurfaceAreaUnitLength_cm²_cm, sectprop_2.VolumeUnitLength_cm³_cm])
model = CreateModel(Properties=editpb.Section, GSAGeometryIn_m=elem1d, ReMesh=True, Tolerance=0.05, Unit="m")
getgeo = GetModelGeometry(GSAModel=model, NodeFilterList="All", ElementFilterList="All", MemberFilterList="All", Mode=1, Unit="m")  # -> NodesIn_m, _1DElementsIn_m, _2DElementsIn_m, _3DElementsIn_m, _1DMembersIn_m, _2DMembersIn_m, _3DMembersIn_m
elem1dedit = Edit1DElement(Element1D=getgeo._1DElementsIn_m, Preview3dSection=False)  # -> Element1D, Number, Line, Section, Group, Type, Offset, StartRelease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
getprops = GetModelProperties(GSAModel=model)  # -> Sections, _2DProperties, _3DProperties
sectionedit_2 = EditSection(Section=elem1dedit.Section)  # -> Section, SectionNumber, SectionProfile, Material, BasicOffset, AddOffsetY_cm, AddOffsetZ_cm, SectionModifier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
item = ListItem(List=getprops.Sections, Index=0, Wrap=True)
getmodifier = GetSectionModifier(SectionModifier=item, DensityUnit="KilogramPerMeter", LengthUnit="Centimeter")  # -> SectionModifier, AreaModifier_cm², I11Modifier_cm⁴, I22Modifier_cm⁴, JModifier, K11Modifier, K22Modifier, VolumeModifier_m³_m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
getmodifier_2 = GetSectionModifier(SectionModifier=sectionedit_2.SectionModifier, DensityUnit="KilogramPerMeter", LengthUnit="Centimeter")  # -> SectionModifier, AreaModifier_cm², I11Modifier_cm⁴, I22Modifier_cm⁴, JModifier, K11Modifier, K22Modifier, VolumeModifier_m³_m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

# ---- group: TObooleans
bool = Boolean([getmodifier_2.PrincipalBendingAxis, getmodifier_2.ReferencePointCentroid])

# ---- group: TOvalues
num = Number([getmodifier_2.AreaModifier_cm², getmodifier_2.I11Modifier_cm⁴, getmodifier_2.I22Modifier_cm⁴, getmodifier_2.JModifier, getmodifier_2.K11Modifier, getmodifier_2.K22Modifier, getmodifier_2.VolumeModifier_m³_m, getmodifier_2.AdditionalMass_kg_m])

# ---- group: TOstressOption
int = Integer(getmodifier_2.StressOptionType)

# ---- group: BYbooleans
bool_2 = Boolean([getmodifier.PrincipalBendingAxis, getmodifier.ReferencePointCentroid])

# ---- group: BYvalues
num_2 = Number([getmodifier.AreaModifier_cm², getmodifier.I11Modifier_cm⁴, getmodifier.I22Modifier_cm⁴, getmodifier.JModifier, getmodifier.K11Modifier, getmodifier.K22Modifier, getmodifier.VolumeModifier_m³_m, getmodifier.AdditionalMass_kg_m])

# ---- group: BYstressOption
int_2 = Integer(getmodifier.StressOptionType)

# ----
panel_2 = Panel(num)
panel_3 = Panel(bool)
panel_4 = Panel(int)
panel_5 = Panel(num_2)
panel_6 = Panel(bool_2)
panel_7 = Panel(int_2)
